# Dynamo graph 240318_BALI_Muro_VARIOS.dyn (Dynamo 2.13.1.3887)
# packages: Clockwork for Dynamo 2.x 2.3.0

# group: Agarrar varios muros cortina. Tiene que ser la familia: SMC_MuroCortina_BALI
select_model_elements = DSModelElementsSelection()  # 4 picked in the model; graph input

byElement = CurtainPanel.ByElement(hostingElement=select_model_elements)
asFamilyInstance = CurtainPanel.AsFamilyInstance(curtainPanel=byElement)

# group: Porcentajes de cada pieza
number_slider = DoubleSlider(10, range=0..100 step 0.1)
number_slider_2 = DoubleSlider(10, range=0..100 step 0.1)
number_slider_3 = DoubleSlider(20, range=0..100 step 0.1)
number_slider_4 = DoubleSlider(60, range=0..100 step 0.1)

flatten = List.Flatten(list=byElement)
count = List.Count(list=flatten)

# group: Ángulos de las piezas.
# Son categorías de una misma familia.
# Estas se itroducen en el
family_types = FamilyTypes("Panel:Pieza 15º")
family_types_2 = FamilyTypes("Panel:Pieza 1º")
family_types_3 = FamilyTypes("Panel:Pieza 35º")
family_types_4 = FamilyTypes("Panel:Pieza 90º")

list_create = List.Create(item0=family_types, item1=family_types_2, item2=family_types_3, item3=family_types_4)

# group: Python Code Asigna ángulos según los sliders
# Deberían sumar 100 entre ellos. Igualmente lo que hace este códifo es interpretar el número de piezas y asignar porcentajes de piezas giradas según los números de IN[0] a IN[3]
python_script = Python(IN[0]=number_slider, IN[1]=number_slider_2, IN[2]=number_slider_3, IN[3]=number_slider_4, IN[4]=count, IN[5]=list_create)  # IronPython2
# ---------- python_script.python (59 lines) ----------
import clr

clr.AddReference('RevitAPI')
from Autodesk.Revit.DB import *
from Autodesk.Revit.DB.Structure import *

clr.AddReference('RevitAPIUI')
from Autodesk.Revit.UI import *

clr.AddReference('System')
from System.Collections.Generic import List

clr.AddReference('RevitNodes')
import Revit
clr.ImportExtensions(Revit.GeometryConversion)
clr.ImportExtensions(Revit.Elements)

clr.AddReference('RevitServices')
import RevitServices
from RevitServices.Persistence import DocumentManager
from RevitServices.Transactions import TransactionManager

doc = DocumentManager.Instance.CurrentDBDocument
uidoc=DocumentManager.Instance.CurrentUIApplication.ActiveUIDocument

#Preparing input from dynamo to revit
A = IN[0]
B = IN[1]
C = IN[2]
D = IN[3]
E = IN[4]

Placas = IN[5]

suma = A+B+C+D
Tipo1 = int(A / suma * E)
Tipo2 = int(B / suma * E)
Tipo3 = int(C / suma * E)
Tipo4 = int(D / suma * E)

l = []
x = 0
for i in range(Tipo1):
    l.append(Placas[0])
for i in range(Tipo2):
    l.append(Placas[1])
for i in range(Tipo3):
    l.append(Placas[2])
for i in range(Tipo4):
    l.append(Placas[3])
for i in range(E-len(l)):
    l.append(Placas[3])
lista = [Tipo1 * E, Tipo2 * E, Tipo3 * E, Tipo4 * E]
#Do some action in a Transaction
TransactionManager.Instance.EnsureInTransaction(doc)

TransactionManager.Instance.TransactionTaskDone()

OUT = l
# ----------------------------------------

# group: Shuffle. Mezcla los resultados para darle aleatoriedad
shuffle = List.Shuffle(list=python_script)

# group: Cambia los curtain walls a las categorías de python+angulos
setType = Custom[FamilyInstance.SetType](familyInstance=asFamilyInstance, familyType=shuffle)  # package Clockwork for Dynamo 2.x; Changes the family type of a given family instance to the specified type

# group: Obtiene la información a cada uno de los curtain panels
parameters = Element.Parameters(element=setType.familyInstance)
number = DoubleInput(22)
getItemAtIndex = List.GetItemAtIndex(list=parameters@L2, index=number)

categories = Categories("OST_Materials")
all_elements_of_category = ElementsOfCategory(Category=categories)

# group: Selecciona materiales con "Placa" en el nombre
python_script_2 = Python(IN[0]=all_elements_of_category)  # IronPython2
# ---------- python_script_2.python (39 lines) ----------
import clr

clr.AddReference('RevitAPI')
from Autodesk.Revit.DB import *
from Autodesk.Revit.DB.Structure import *

clr.AddReference('RevitAPIUI')
from Autodesk.Revit.UI import *

clr.AddReference('System')
from System.Collections.Generic import List

clr.AddReference('RevitNodes')
import Revit
clr.ImportExtensions(Revit.GeometryConversion)
clr.ImportExtensions(Revit.Elements)

clr.AddReference('RevitServices')
import RevitServices
from RevitServices.Persistence import DocumentManager
from RevitServices.Transactions import TransactionManager

doc = DocumentManager.Instance.CurrentDBDocument
uidoc=DocumentManager.Instance.CurrentUIApplication.ActiveUIDocument

#Preparing input from dynamo to revit
elements = IN[0]

hola = []

for element in elements:
	if "Placa Metal" in element.Name:
		hola.append(element)
		
OUT= hola
#Do some action in a Transaction
TransactionManager.Instance.EnsureInTransaction(doc)

TransactionManager.Instance.TransactionTaskDone()
# ----------------------------------------

count_2 = List.Count(list=flatten)

# group: Mezcla materiales
cycle = List.Cycle(list=python_script_2, amount=count_2)
shuffle_2 = List.Shuffle(list=cycle)

# group: Selecciona el número de items necesarios
takeItems = List.TakeItems(list=shuffle_2, amount=count_2)

setValue = Parameter.SetValue(parameter=getItemAtIndex, value=takeItems@L2)

# group: CONSIDERACIONES
# Hay que seleccionar SOLO LOS MUROS CORTINA DE LA FAMILIA ESPECIFICADA.
# Si se selecciona algo que no es el muro no funciona.
# Recomiendo "Isolate Category" para seleccionar los muros.
code_block = CodeBlock {  }

select_model_element = DSModelElementSelection()  # 1 picked in the model
byElement_2 = CurtainPanel.ByElement(hostingElement=select_model_element)
asFamilyInstance_2 = CurtainPanel.AsFamilyInstance(curtainPanel=byElement_2)
number_slider_5 = DoubleSlider(10, range=0..100 step 0.1)
number_slider_6 = DoubleSlider(10, range=0..100 step 0.1)
number_slider_7 = DoubleSlider(20, range=0..100 step 0.1)
number_slider_8 = DoubleSlider(60, range=0..100 step 0.1)
count_3 = List.Count(list=byElement_2)
family_types_5 = FamilyTypes("Panel:Pieza 15º")
family_types_6 = FamilyTypes("Panel:Pieza 1º")
family_types_7 = FamilyTypes("Panel:Pieza 35º")
family_types_8 = FamilyTypes("Panel:Pieza 90º")
list_create_2 = List.Create(item0=family_types_5, item1=family_types_6, item2=family_types_7, item3=family_types_8)
python_script_3 = Python(IN[0]=number_slider_5, IN[1]=number_slider_6, IN[2]=number_slider_7, IN[3]=number_slider_8, IN[4]=count_3, IN[5]=list_create_2)  # IronPython2
# ---------- python_script_3.python (59 lines) ----------
import clr

clr.AddReference('RevitAPI')
from Autodesk.Revit.DB import *
from Autodesk.Revit.DB.Structure import *

clr.AddReference('RevitAPIUI')
from Autodesk.Revit.UI import *

clr.AddReference('System')
from System.Collections.Generic import List

clr.AddReference('RevitNodes')
import Revit
clr.ImportExtensions(Revit.GeometryConversion)
clr.ImportExtensions(Revit.Elements)

clr.AddReference('RevitServices')
import RevitServices
from RevitServices.Persistence import DocumentManager
from RevitServices.Transactions import TransactionManager

doc = DocumentManager.Instance.CurrentDBDocument
uidoc=DocumentManager.Instance.CurrentUIApplication.ActiveUIDocument

#Preparing input from dynamo to revit
A = IN[0]
B = IN[1]
C = IN[2]
D = IN[3]
E = IN[4]

Placas = IN[5]

suma = A+B+C+D
Tipo1 = int(A / suma * E)
Tipo2 = int(B / suma * E)
Tipo3 = int(C / suma * E)
Tipo4 = int(D / suma * E)

l = []
x = 0
for i in range(Tipo1):
    l.append(Placas[0])
for i in range(Tipo2):
    l.append(Placas[1])
for i in range(Tipo3):
    l.append(Placas[2])
for i in range(Tipo4):
    l.append(Placas[3])
for i in range(E-len(l)):
    l.append(Placas[1])
lista = [Tipo1 * E, Tipo2 * E, Tipo3 * E, Tipo4 * E]
#Do some action in a Transaction
TransactionManager.Instance.EnsureInTransaction(doc)

TransactionManager.Instance.TransactionTaskDone()

OUT = l
# ----------------------------------------
shuffle_3 = List.Shuffle(list=python_script_3)
setType_2 = Custom[FamilyInstance.SetType](familyInstance=asFamilyInstance_2, familyType=shuffle_3)
parameters_2 = Element.Parameters(element=setType_2.familyInstance)
number_2 = DoubleInput(22)
getItemAtIndex_2 = List.GetItemAtIndex(list=parameters_2@L2, index=number_2)
categories_2 = Categories("OST_Materials")
all_elements_of_category_2 = ElementsOfCategory(Category=categories_2)
python_script_4 = Python(IN[0]=all_elements_of_category_2)  # IronPython2; same code as python_script_2
count_4 = List.Count(list=byElement_2)
cycle_2 = List.Cycle(list=python_script_4, amount=count_4)
shuffle_4 = List.Shuffle(list=cycle_2)
takeItems_2 = List.TakeItems(list=shuffle_4, amount=count_4)
setValue_2 = Parameter.SetValue(parameter=getItemAtIndex_2, value=takeItems_2@L2)

# group: VARIOS MUROS
code_block_2 = CodeBlock {  }

# group: UN MURO
code_block_3 = CodeBlock {  }
