# Dynamo graph Home.dyn (Dynamo 2.6.1.8786)

select_model_element = DSModelElementSelection()  # 1 picked in the model
geometry = Element.Geometry(element=select_model_element)
startPoint = Curve.StartPoint(curve=geometry)
code_block = CodeBlock { 5; }
code_block_2 = CodeBlock { 3; }
byOriginRadii = Ellipse.ByOriginRadii(origin=startPoint, xAxisRadius=code_block, yAxisRadius=code_block_2)
byPatch = Surface.ByPatch(closedCurve=byOriginRadii)
area = Surface.Area(surface=byPatch)
endPoint = Curve.EndPoint(curve=geometry)
trim = Geometry.Trim(geometry=geometry, other=byOriginRadii, pick=endPoint)
length = Curve.Length(curve=trim)
intersect = Geometry.Intersect(geometry=geometry, other=byOriginRadii)
code_block_3 = CodeBlock { 5.5; }
byCenterPointRadius = Circle.ByCenterPointRadius(centerPoint=intersect, radius=code_block_3)
intersect_2 = Geometry.Intersect(geometry=geometry, other=byCenterPointRadius)
lastItem = List.LastItem(list=intersect_2@L2)
byOriginRadii_2 = Ellipse.ByOriginRadii(origin=lastItem, xAxisRadius=code_block, yAxisRadius=code_block_2)
intersect_3 = Geometry.Intersect(geometry=geometry, other=byOriginRadii_2)
lastItem_2 = List.LastItem(list=intersect_3@L2)
distanceTo = Geometry.DistanceTo(geometry=byOriginRadii, other=byOriginRadii_2)
code_block_4 = CodeBlock { 1..10..1; }
python_script = Python(IN[0]=lastItem, IN[1]=code_block, IN[2]=code_block_2, IN[3]=geometry, IN[4]=code_block_4)
# ---------- python_script.python (38 lines) ----------
# Load the Python Standard and DesignScript Libraries
import clr
clr.AddReference("ProtoGeometry")
from Autodesk.DesignScript.Geometry import *

# Import ToDSType(bool) extension method
clr.AddReference("RevitNodes")
import Revit
clr.ImportExtensions(Revit.Elements)

#Preparing input from dynamo to revit
a =UnwrapElement(IN[0])
curve = IN[3]
B =IN[1]
c =IN[2]
ellipses = []
puntos = []

def drange(start, stop, step):
	r = start
	while r < stop:
		yield r
		r+= step
#Primero crear una elipse y que interseque con la Spline
for p in a:
	if curve[0].DoesIntersect(p):
		e = Ellipse.ByOriginRadii(p,3,5)
		ellipses.append(e)
		f = e.Intersect(curve[0])[0] 
	if (Ellipse.ByOriginRadii(p,2,4).Intersect(curve[0])[0]).DistanceTo(f) < 10:
		g = "hola"
	e = Ellipse.ByOriginRadii(p,2,4)
	x = drange(0, 10, 0.025)
for p in x:
	if curve[0].PointAtParameter(p) == f:
		points.append(curve[0].PointAtParameter(p))
		
OUT = g
# ----------------------------------------
doesIntersect = Geometry.DoesIntersect()  # unwired: geometry, other
intersect_4 = Geometry.Intersect()  # unwired: geometry, other
pointAtParameter = Curve.PointAtParameter(curve=geometry, param=code_block_4)
length_2 = Curve.Length(curve=geometry)
distanceTo_2 = Geometry.DistanceTo()  # unwired: geometry, other
