# Dynamo graph Pyton.dyn (Dynamo 2.6.1.8786)
# packages: spring nodes 210.1.1

ZAxis = Vector.ZAxis()
code_block = CodeBlock { -2.5; }
translate = Geometry.Translate(direction=ZAxis, distance=code_block)  # unwired: geometry
categories = Categories("OST_GenericModel")
select_model_element = DSModelElementSelection()  # 1 picked in the model
geometry = Element.Geometry(element=select_model_element)
select_model_element_2 = DSModelElementSelection()  # 1 picked in the model
geometry_2 = Element.Geometry(element=select_model_element_2)
python_script = Python(IN[0]=geometry, IN[1]=geometry_2)
# ---------- python_script.python (69 lines) ----------
# Load the Python Standard and DesignScript Libraries
import clr
clr.AddReference("ProtoGeometry")
from Autodesk.DesignScript.Geometry import *

# Import ToDSType(bool) extension method
clr.AddReference("RevitNodes")
import Revit
clr.ImportExtensions(Revit.Elements)

#Preparing input from dynamo to revit

curve = IN[0]
curva2 = IN[1]
puntos = [curve[0].StartPoint]
hilera2 = curve[0].Offset(2.5)
hilera3 = hilera2.Offset(2.5)
#ellipses = [e1]
vx = Vector.ByCoordinates(1,2.8,0)
vy = Vector.ByCoordinates(3,4,0)

#Ellipse.ByOriginVectors(KRV.StartPoint,vx,vy)

#Primero crear una elipse y que interseque con la Spline

def elsep(KRV):
	#rango = range(0,int(KRV.Length))
	rango = [float(x)/2 for x in range(0, int(curve[0].Length)*2)]
	ellipsesgroup = [Ellipse.ByOriginVectors(KRV.StartPoint,vx,vy)]
	eanterior =Ellipse.ByOriginVectors(KRV.StartPoint,vx,vy)
	pp = eanterior.Intersect(KRV)
	for p in rango: 
		point = KRV.PointAtSegmentLength(p)
		if (pp[0].DistanceTo(Ellipse.ByOriginVectors(point,vx,vy)) <= 2) and (eanterior.DoesIntersect(Ellipse.ByOriginVectors(point,vx,vy)) == False) and (pp[0].DistanceTo(Ellipse.ByOriginVectors(point,vx,vy)) >= 1.5):
			nuevaelipse = Ellipse.ByOriginVectors(point,vx,vy)
			ellipsesgroup.append(nuevaelipse)
			eanterior = nuevaelipse		
			puntos.append(point)
			pp = eanterior.Intersect(KRV)
	return ellipsesgroup
	
v = Vector.ByCoordinates(0, 0, 1);		
prueba = elsep(curve[0])

hilera1 = []
for elipse in prueba:
	solid = elipse.ExtrudeAsSolid(v,4)
	hilera1.append(solid)
hilera2curve = curve[0].Offset(2.5)
hilera2pts = []
hilera2eli = []
for p in puntos:
	hilera2pts.append(hilera2curve.ClosestPointTo(p))
	hilera2eli.append((Ellipse.ByOriginVectors(hilera2curve.ClosestPointTo(p),vx,vy)).ExtrudeAsSolid(v,-4))
	
hilera3curve = curve[0].Offset(5)
hilera3pts = []
hilera3eli = []
for p in hilera2pts:
	hilera3pts.append(hilera3curve.ClosestPointTo(p))
	hilera3eli.append(((Ellipse.ByOriginVectors(hilera3curve.ClosestPointTo(p),vx,vy)).ExtrudeAsSolid(v,-4)).Translate(v,-4))
	
prueba3 = elsep(curva2[0])
hilera4 = []
for eli in prueba3:
	hilera4.append((eli.ExtrudeAsSolid(v,4)))
#OUT = prueba, prueba2, prueba3
#OUT = drange(0,10,0.15)
OUT = prueba,hilera1, hilera2curve, puntos, hilera2pts, hilera2eli, hilera3eli, [vx.Length, vy.Length], hilera4
# ----------------------------------------
code_block_2 = CodeBlock { List.Flatten([1,5,6]); }
getItemAtIndex = List.GetItemAtIndex(list=python_script, index=code_block_2@L1)
flatten = List.Flatten(list=getItemAtIndex)
count = List.Count(list=flatten)
code_block_3 = CodeBlock(a=count) { List.Flatten("elipse" + [1..a..1]); }
ꟿ_directshape_bygeometry = Custom[ꟿ DirectShape.ByGeometry](geometry=translate, category=categories, name=code_block_3)  # package spring nodes; Convert the input geometry to DirectShape element inside the Revit document. It supports solids or surfaces. It is based on an alternative process that uses a SAT import and can produce smooth surfaces. Each created DS will have a unique type. Make sure that each input geometry has a unique name. You can either feed a single category for all geometries or a unique category for each geometry - the node's lacing is set to longest by default. The default category is Generic Models.
