# Dynamo graph TEC_Costillas.dyn "Costillas" (Dynamo 2.3.0.5885)

select_model_element = DSModelElementSelection()  # 1 picked in the model
curves = Element.Curves(element=select_model_element)
startPoint = Curve.StartPoint(curve=curves)
number_slider = DoubleSlider(0, range=0..100 step 0.1)
tangentAtParameter = Curve.TangentAtParameter(curve=curves, param=number_slider)

# group: Cuadrado
number = DoubleInput(0.2)
byCenterPointRadiusNormal = Circle.ByCenterPointRadiusNormal(centerPoint=startPoint, radius=number, normal=tangentAtParameter)
number_2 = DoubleInput(4)
regularPolygon = Polygon.RegularPolygon(circle=byCenterPointRadiusNormal, numberSides=number_2)
number_3 = DoubleInput(55)
rotate = Geometry.Rotate(geometry=regularPolygon, origin=startPoint, axis=tangentAtParameter, degrees=number_3)

byOriginNormal = Plane.ByOriginNormal(origin=startPoint, normal=tangentAtParameter)
number_slider_2 = DoubleSlider(0.25, range=0..100 step 0.1)
number_slider_3 = DoubleSlider(0.1, range=0..100 step 0.1)
byWidthLength = Rectangle.ByWidthLength(plane=byOriginNormal, width=number_slider_2, length=number_slider_3)
number_4 = DoubleInput(-11.5)
rotate_2 = Geometry.Rotate(geometry=byWidthLength, basePlane=byOriginNormal, degrees=number_4)
sweepAsSolid = Curve.SweepAsSolid(curve=rotate_2, path=curves)
categories = Categories("OST_StructuralFraming")
string = StringInput("00_Madera Vigas")
byName = Material.ByName(name=string)
string_2 = StringInput("Costillas")
byGeometry = DirectShape.ByGeometry(geometry=sweepAsSolid, category=categories, material=byName, name=string_2)
