# Dynamo graph TEC_ElementoPergola.dyn "Lunch" (Dynamo 2.3.0.5885)

select_model_elements = DSModelElementsSelection()  # 2 picked in the model
curves = Element.Curves(element=select_model_elements)
byJoinedCurves = PolyCurve.ByJoinedCurves(curves=curves)
code_block = CodeBlock { 0..2..#20; }
pointAtSegmentLength = Curve.PointAtSegmentLength(curve=byJoinedCurves@L1, segmentLength=code_block)
isNull = Object.IsNull(obj=pointAtSegmentLength)
filterByBoolMask = List.FilterByBoolMask(list=pointAtSegmentLength, mask=isNull)
flatten = List.Flatten(list=filterByBoolMask.out)
number_slider = DoubleSlider(0.05, range=0..100 step 0.1)
XAxis = Vector.XAxis()
byCenterPointRadiusNormal = Circle.ByCenterPointRadiusNormal(centerPoint=flatten, radius=number_slider, normal=XAxis)
number = DoubleInput(4)
regularPolygon = Polygon.RegularPolygon(circle=byCenterPointRadiusNormal, numberSides=number)
XAxis_2 = Vector.XAxis()
number_2 = DoubleInput(45)
rotate = Geometry.Rotate(geometry=regularPolygon, origin=flatten, axis=XAxis_2, degrees=number_2)
select_model_element = DSModelElementSelection()  # 1 picked in the model
curves_2 = Element.Curves(element=select_model_element)
code_block_2 = CodeBlock { [0..0.65..#9]; }
pointAtSegmentLength_2 = Curve.PointAtSegmentLength(curve=curves_2@L1, segmentLength=code_block_2@L2)
XAxis_3 = Vector.XAxis()
byCenterPointRadiusNormal_2 = Circle.ByCenterPointRadiusNormal(centerPoint=pointAtSegmentLength_2, radius=number_slider, normal=XAxis_3)
number_3 = DoubleInput(4)
regularPolygon_2 = Polygon.RegularPolygon(circle=byCenterPointRadiusNormal_2, numberSides=number_3)
XAxis_4 = Vector.XAxis()
code_block_3 = CodeBlock { [0..1..#9]; }
tangentAtParameter = Curve.TangentAtParameter(curve=curves_2, param=code_block_3)
ZAxis = Vector.ZAxis()
angleWithVector = Vector.AngleWithVector(vector=tangentAtParameter, otherVector=ZAxis)
number_4 = DoubleInput(45)
sub = angleWithVector - number_4
rotate_2 = Geometry.Rotate(geometry=regularPolygon_2, origin=pointAtSegmentLength_2, axis=XAxis_4, degrees=sub)
list_create = List.Create(item0=rotate, item1=rotate_2)
flatten_2 = List.Flatten(list=list_create@L4)
startPoint = Curve.StartPoint(curve=curves_2)
number_slider_2 = DoubleSlider(-4.5, range=-4.5..100 step 0.1)
byStartPointDirectionLength = Line.ByStartPointDirectionLength(startPoint=startPoint, direction=XAxis_2, length=number_slider_2)
sweepAsSolid = Curve.SweepAsSolid(curve=flatten_2, path=byStartPointDirectionLength)
categories = Categories("OST_GenericModel")
byGeometry = DirectShape.ByGeometry(geometry=sweepAsSolid, category=categories)
select_model_element_2 = DSModelElementSelection()  # nothing selected
parameters = Element.Parameters(element=select_model_element_2)
setValue = Parameter.SetValue(parameter=parameters)  # unwired: value
value = Parameter.Value(parameter=parameters)
