# Dynamo graph TEC_ValladobySplineNormalDir.dyn "GirarVersionMasaX" (Dynamo 2.3.0.5885)

# group: Camino que realiza el vallado
select_model_element = DSModelElementSelection()  # 1 picked in the model

# group: Convierte Curva de Revit en Curva de DYNAMO
curves = Element.Curves(element=select_model_element)

# group: Dividir Curva por Nº de segmentos
number_slider = DoubleSlider(20, range=0..100 step 0.1)
pointsAtEqualChordLength = Curve.PointsAtEqualChordLength(curve=curves, divisions=number_slider)

# group: Nombre de la familia
string = StringInput("1525 x 762mm")

# group: Dividir Curva por longitud de Segmento
startPoint = Curve.StartPoint(curve=curves)
number_slider_2 = DoubleSlider(3, range=0..100 step 0.1)
pointsAtChordLengthFromPoint = Curve.PointsAtChordLengthFromPoint(curve=curves, point=startPoint, chordLength=number_slider_2)

# group: Crear Difirentes puntos equidistantes en la curva, sumar el comienzo y el final y dividir la curva por puntos
startPoint_2 = Curve.StartPoint(curve=curves)
endPoint = Curve.EndPoint(curve=curves)
list_create = List.Create(item0=startPoint_2, item1=pointsAtChordLengthFromPoint, item2=endPoint)
flatten = List.Flatten(list=list_create)
splitByPoints = Curve.SplitByPoints(curve=curves, points=flatten)

# group: Punto desde el que comienza el vector por cada segmento
number_slider_3 = DoubleSlider(0, range=0..100 step 0.1)

tangentAtParameter = Curve.TangentAtParameter(curve=splitByPoints)

# group: Visualizar los Vectores Normales a la curva
pointAtParameter = Curve.PointAtParameter(curve=splitByPoints, param=number_slider_3)
add = Point.Add(point=pointAtParameter, vectorToAdd=tangentAtParameter)
byStartPointEndPoint = Line.ByStartPointEndPoint(startPoint=pointAtParameter, endPoint=add)

family_types = FamilyTypes("FamiliaParametroGiro:FamiliaParametroGiro")

# group: GiroFamilia
byPoint = FamilyInstance.ByPoint(familyType=family_types, point=flatten)

# group: Obtener Vectores y discriminar por Y o -Y
Y = Vector.Y(vector=tangentAtParameter)
number = DoubleInput(0)
lt = Y < number
normalAtParameter = Curve.NormalAtParameter(curve=splitByPoints, param=number_slider_3)
filterByBoolMask = List.FilterByBoolMask(list=normalAtParameter, mask=lt)

# group: Reordenar Familias igual que Vectores
flatten_2 = List.Flatten(list=lt)
filterByBoolMask_2 = List.FilterByBoolMask(list=byPoint, mask=flatten_2)

# group: Nombre del parámetro de Giro
parámetro_de_giro = StringInput("Angulo de giro")

# group: Invertir direccion de Vectores que salen para el lado contrario
number_2 = DoubleInput(-1)
byCoordinates = Vector.ByCoordinates(x=number_2)
number_3 = DoubleInput(180)
rotate = Vector.Rotate(vector=filterByBoolMask.in, axis=byCoordinates, degrees=number_3)

# group: Vector de Referencia de giro
XAxis = Vector.XAxis()
curves_2 = Element.Curves()  # unwired: element
direction = Line.Direction(line=curves_2)

# group: Multiples Lineas
select_model_elements = DSModelElementsSelection()  # 5 picked in the model
curves_3 = Element.Curves(element=select_model_elements)
byJoinedCurves = PolyCurve.ByJoinedCurves(curves=curves_3)

byPoints = PolyCurve.ByPoints(points=flatten)

# group: Curvatura Poste
select_model_element_2 = DSModelElementSelection()  # 1 picked in the model

curves_4 = Element.Curves(element=select_model_element_2)
curves_5 = Element.Curves(element=select_model_element)
planeAtParameter = Curve.PlaneAtParameter(curve=curves_5)
normal = Plane.Normal(plane=planeAtParameter)

# group: Plano Curvatura
startPoint_3 = Curve.StartPoint(curve=curves_5)
byCenterPointRadiusNormal = Circle.ByCenterPointRadiusNormal(centerPoint=startPoint_3, normal=normal)
byPatch = Surface.ByPatch(closedCurve=byCenterPointRadiusNormal)
byGeometry = ImportInstance.ByGeometry(geometry=byPatch)

byPoints_2 = PolyCurve.ByPoints(points=flatten)
curves_6 = Element.Curves(element=select_model_element)
planeAtParameter_2 = Curve.PlaneAtParameter(curve=curves_6)
normal_2 = Plane.Normal(plane=planeAtParameter_2)
code_block = CodeBlock { [0.0..1..#10]; }
curves_7 = Element.Curves(element=select_model_element_2)
number_4 = DoubleInput(-0.1)
translate = Geometry.Translate(yTranslation=number_4)  # unwired: geometry
string_2 = StringInput("Generic Models")
byName = Category.ByName(name=string_2)
string_3 = StringInput("Air")
byName_2 = Material.ByName(name=string_3)
string_4 = StringInput("Vallado")
byGeometry_2 = DirectShape.ByGeometry(geometry=translate, category=byName, material=byName_2, name=string_4)
bySweep = Surface.BySweep()  # unwired: profile, path
number_5 = DoubleInput(0.005)
bySweep_2 = Surface.BySweep()  # unwired: profile, path
X = Vector.X(vector=normalAtParameter)
YAxis = Vector.YAxis()
XAxis_2 = Vector.XAxis()
ZAxis = Vector.ZAxis()
angleAboutAxis = Vector.AngleAboutAxis(vector=tangentAtParameter, otherVector=XAxis_2, rotationAxis=ZAxis)
flatten_3 = List.Flatten(list=angleAboutAxis)
setRotation = FamilyInstance.SetRotation(familyInstance=byPoint, degree=flatten_3)
XAxis_3 = Vector.XAxis()
ZAxis_2 = Vector.ZAxis()
angleAboutAxis_2 = Vector.AngleAboutAxis(vector=filterByBoolMask.out, otherVector=XAxis_3, rotationAxis=ZAxis_2)
flatten_4 = List.Flatten(list=angleAboutAxis_2)
setRotation_2 = FamilyInstance.SetRotation(degree=flatten_4)  # unwired: familyInstance
byPoints_3 = PolyCurve.ByPoints(points=flatten)
select_model_element_3 = DSModelElementSelection()  # 1 picked in the model
curves_8 = Element.Curves(element=select_model_element_3)
curves_9 = Element.Curves(element=select_model_element_2)
bySweep2Rails = Surface.BySweep2Rails(path=byPoints_3, guideRail=curves_8, profile=curves_9)
bySweep_3 = Surface.BySweep()  # unwired: profile, path
