# Dynamo graph Hacer camino sobre topografia.dyn (Dynamo 2.13.1.3887)
# packages: Clockwork for Dynamo 2.x 2.3.0

select_model_element = DSModelElementSelection()  # 1 picked in the model
geometry = Element.Geometry(element=select_model_element)
lastItem = List.LastItem(list=geometry)
faceVertices = Custom[Mesh.FaceVertices](mesh=lastItem)  # package Clockwork for Dynamo 2.x; Gets the vertices of each face of a given mesh
ZAxis = Vector.ZAxis()
number = DoubleInput(0)
translate = Geometry.Translate(geometry=faceVertices, direction=ZAxis, distance=number)
flatten = List.Flatten(list=translate)
byPerimeterPoints = Surface.ByPerimeterPoints(points=faceVertices)
byJoinedSurfaces = PolySurface.ByJoinedSurfaces(surfaces=byPerimeterPoints)
perimeterCurves = Surface.PerimeterCurves(surface=byJoinedSurfaces)
reverse = Vector.Reverse(vector=ZAxis)
number_2 = DoubleInput(500)
extrude = Curve.Extrude(curve=perimeterCurves, direction=reverse, distance=number_2)
byOriginNormal = Plane.ByOriginNormal()
intersect = Geometry.Intersect(geometry=extrude, other=byOriginNormal)
flatten_2 = List.Flatten(list=intersect)
floor_types = FloorTypes()  # nothing selected
levels = Levels()  # nothing selected
byOutlineTypeAndLevel = Floor.ByOutlineTypeAndLevel(outline=flatten_2, floorType=floor_types, level=levels)
end = Revit.Transaction.Transaction.End(input=byOutlineTypeAndLevel)
slabShapeByPoints = Custom[Floor.SlabShapeByPoints](points=flatten, floor=end)  # package Clockwork for Dynamo 2.x; Transform a slab shape based on a list of Points
