# Dynamo graph Home.dyn (Dynamo 2.6.1.8786)

origin = Point.Origin()
code_block = CodeBlock { -0.1; }
code_block_2 = CodeBlock { -1; }
random = Math.Random(value1=code_block, value2=code_block_2)
code_block_3 = CodeBlock(n=random) { Point.ByCoordinates(0,1.5,n); }
code_block_4 = CodeBlock { Point.ByCoordinates(0,3,0); }
list_create = List.Create(item0=origin, item1=code_block_3, item2=code_block_4)
byPoints = NurbsCurve.ByPoints(points=list_create)
code_block_5 = CodeBlock { Point.ByCoordinates(3,0,0); }
code_block_6 = CodeBlock { Point.ByCoordinates(3,1.5,n); }  # unwired: n
code_block_7 = CodeBlock { Point.ByCoordinates(3,3,0); }
list_create_2 = List.Create(item0=code_block_5, item1=code_block_6, item2=code_block_7)
byPoints_2 = NurbsCurve.ByPoints(points=list_create_2)
list_create_3 = List.Create(item0=byPoints, item1=byPoints_2)
byLoft = Surface.ByLoft(crossSections=list_create_3)
