# Dynamo graph OpenAI DALL-E Demo.dyn (Dynamo 2.17.0.3236)

activate = BoolSelector(true)

# group: You need to have an OpenAI API Key to run this demo
# An API key is like a fixed unique "password" that is associated with your OpenAI account. It allows you to access the OpenAI services from programming code.
# How to obtain an API key:
# 1. If you don't have an OpenAI account yet, register for one at: https://beta.openai.com/signup
# (Each new account will get 18 US Dollars worth of free credits, valid for 3 months.
# Generating texts and/or images WILL cost credits)
# 2. Log-in to your account
# 4. Go to your account settings and look for the API Key session, and create a new API key.
# 6. Copy and Paste the API key here in Grasshopper
# (IMPORTANT: Keep your API key private, otherwise other people may use it to access your OpenAI account and credits!)
openai_api_key = StringInput("")

prompt = StringInput("A cute corgi using AutoCAD, 3D art, ultra detailed, dramatic lighting")
image_size_string = StringInput("256x256")
number_of_images = DoubleInput(1)
python_script = Python(IN[0]=activate, IN[1]=openai_api_key, IN[2]=prompt, IN[3]=image_size_string, IN[4]=number_of_images)  # CPython3
# ---------- python_script.python (35 lines) ----------
import json
from System.Net import WebClient
from System import Convert
from System.IO import MemoryStream
from System.Drawing import Bitmap


if IN[0]:

    webClient = WebClient()
    webClient.Headers.Add("Content-Type", "application/json")
    webClient.Headers.Add("Authorization", "Bearer " + IN[1])
    
    url = "https://api.openai.com/v1/images/generations";
    
    parameters = json.dumps({
        "model": "image-alpha-001",
        "prompt": IN[2],
        "size": IN[3],
        "n": IN[4],
        "response_format": "b64_json"})

    
    response = json.loads(webClient.UploadString(url, parameters))
   
    #Extract the bitmap images from the web response:

    bitmaps = []
    
    for i, imageData in enumerate(response["data"]):
        memoryStream = MemoryStream(Convert.FromBase64String(imageData["b64_json"]));
        bitmaps.append(Bitmap.FromStream(memoryStream))
        memoryStream.Close();
   
    OUT = bitmaps
# ----------------------------------------
integer_slider = IntegerSlider(0, range=0..100 step 1)
getItemAtIndex = List.GetItemAtIndex(list=python_script, index=integer_slider)
watch_image = WatchImageCore(image=getItemAtIndex)
