# Dynamo graph OpenAI Language Demo - Single Answer.dyn (Dynamo 2.17.0.3236)

activate = BoolSelector(true)

# group: You need to have an OpenAI API Key to run this demo
# An API key is like a fixed unique "password" that is associated with your OpenAI account. It allows you to access the OpenAI services from programming code.
# How to obtain an API key:
# 1. If you don't have an OpenAI account yet, register for one at: https://beta.openai.com/signup
# (Each new account will get 18 US Dollars worth of free credits, valid for 3 months.
# Generating texts and/or images WILL cost credits)
# 2. Log-in to your account
# 4. Go to your account settings and look for the API Key session, and create a new API key.
# 6. Copy and Paste the API key here in Grasshopper
# (IMPORTANT: Keep your API key private, otherwise other people may use it to access your OpenAI account and credits!)
openai_api_key = StringInput("")

# group: For a full descriptions of different choices of language models, see: https://beta.openai.com/docs/models/gpt-3
l_anguage_model_string = StringInput("text-davinci-003")

max_tokens = DoubleInput(1000)
temperature = DoubleInput(0.7)
prompt = StringInput("Tell me a super cheesy and cringe worthy story about an architect and a structural engineer")
python_script = Python(IN[0]=activate, IN[1]=openai_api_key, IN[2]=l_anguage_model_string, IN[3]=max_tokens, IN[4]=temperature, IN[5]=prompt)  # CPython3
# ---------- python_script.python (29 lines) ----------
import json
from System.Net import WebClient


if IN[0]:

    webClient = WebClient()
    webClient.Headers.Add("Content-Type", "application/json")
    webClient.Headers.Add("Authorization", "Bearer " + IN[1])
    
    parameters = json.dumps({
        "model": IN[2],
        "max_tokens": IN[3],
        "temperature": IN[4],
        "prompt": IN[5],
        })
        
    url = "https://api.openai.com/v1/completions"
        
    # Send the request to the OpenAI server and obtain a response:
    response = json.loads(webClient.UploadString(url, parameters))

    # Extract the actual text from the web response
    responseText = response["choices"][0]["text"]
    
     # Remove the line breaks at the start of the text otherwise Dynamo many not display the text correctly
    responseText = responseText[2:]
    
    OUT = responseText
# ----------------------------------------
watch = Watch(python_script)
