# Dynamo graph Perforaciones.dyn (Dynamo 2.13.1.3887)

select_model_element = DSModelElementSelection()  # 1 picked in the model
byCoordinates = Point.ByCoordinates()
XAxis = Vector.XAxis()
code_block = CodeBlock { 45; }
code_block_2 = CodeBlock(n=code_block) { 0..n*5-1..5; }
translate = Geometry.Translate(geometry=byCoordinates, direction=XAxis, distance=code_block_2)
YAxis = Vector.YAxis()
code_block_3 = CodeBlock { 20; }
code_block_4 = CodeBlock(n=code_block_3) { 0..n*5-1..5; }
translate_2 = Geometry.Translate(geometry=translate@L1, direction=YAxis, distance=code_block_4)
byCenterPointRadius = Circle.ByCenterPointRadius(centerPoint=translate_2)
code_block_5 = CodeBlock { 1; 0; 0.6; 1.8; }
file_path = Filename("..\..\..\..\..\Miguel\Escritorio\PruebaPerforaciones-Model copia.jpg")
file_from_path = FileObject(path=file_path)
readFromFile = Image.ReadFromFile(file=file_from_path)
pixels = Image.Pixels(image=readFromFile, xSamples=code_block_3, ySamples=code_block)
brightness = Color.Brightness(color=pixels)
mapTo = Math.MapTo(rangeMin=code_block_5.out0, rangeMax=code_block_5.out1, inputValue=brightness, targetRangeMin=code_block_5.out2, targetRangeMax=code_block_5.out3)
number = DoubleInput(0.02)
number_2 = DoubleInput(0.035)
number_3 = DoubleInput(0.05)
number_4 = DoubleInput(0.06)
python_script = Python(IN[0]=mapTo, IN[1]=number, IN[2]=number_2, IN[3]=number_3, IN[4]=number_4)  # CPython3
# ---------- python_script.python (34 lines) ----------
# Load the Python Standard and DesignScript Libraries
import sys
import clr
clr.AddReference('ProtoGeometry')
from Autodesk.DesignScript.Geometry import *

# The inputs to this node will be stored as a list in the IN variables.
dato = IN[0]
grosor1 = IN[1]
grosor2 = IN[2]
grosor3 = IN[3]
grosor4 = IN[4]
# Create a new list to store the modified values
lista = []
# Place your code below this line
for i in range(len(dato)):
    row = dato[i]
    new_row = []  # Create a new row to store modified values
    for j in range(len(row)):
        value = float(row[j])
        if value < 0.7 and value > 0.5:
            new_row.append(grosor1)
        elif value < 1.05 and value > 0.7:
            new_row.append(grosor2)
        elif value < 1.6 and value > 1.05:
            new_row.append(grosor3)
        elif value > 1.6:
            new_row.append(grosor4)
        else:
            new_row.append(value)
    lista.append(new_row)

# Assign your output to the OUT variable.
OUT = lista
# ----------------------------------------
byCurve = ModelCurve.ByCurve()  # unwired: curve
